# Grasshopper definition 131108_DynamicRelaxation_pn.gh (Grasshopper 0.9.61)
# plug-ins: Python Interpreter

# ----
# MATERIALS
youngs_modulus_of_elasticity_e = Slider(500000, range=0..1000000)
youngs_modulus_of_elasticity_e_2 = Slider(500000, range=0..1000000)
youngs_modulus_of_elasticity_e_3 = Slider(500000, range=0..1000000)
second_moment_of_inertia_i = Slider(0.81, range=0..1)
second_moment_of_inertia_i_2 = Slider(0.81, range=0..1)
second_moment_of_inertia_i_3 = Slider(0.81, range=0..1)
coefficient = Slider(0.81, range=0..1)
coefficient_2 = Slider(0.81, range=0..1)
coefficient_3 = Slider(0.81, range=0..1)
sectional_area_a = Slider(0.25, range=0..1)
sectional_area_a_2 = Slider(0.25, range=0..1)
sectional_area_a_3 = Slider(0.25, range=0..1)
merge = Merge(
    Data1="MATERIAL ONE",
    Data2=youngs_modulus_of_elasticity_e,
    Data3=sectional_area_a_2,
    Data4=second_moment_of_inertia_i_3,
    Data5=coefficient)
merge_2 = Merge(
    Data1="MATERIAL TWO",
    Data2=youngs_modulus_of_elasticity_e_2,
    Data3=sectional_area_a,
    Data4=second_moment_of_inertia_i,
    Data5=coefficient_2)
merge_3 = Merge(
    Data1="MATERIAL THREE",
    Data2=youngs_modulus_of_elasticity_e_3,
    Data3=sectional_area_a_3,
    Data4=second_moment_of_inertia_i_2,
    Data5=coefficient_3)
path_mapper = PathMapper(merge, source="{0}", target="{0}")
path_mapper_2 = PathMapper(merge_2, source="{0}", target="{1}")
path_mapper_3 = PathMapper(merge_3, source="{0}", target="{2}")

# ----
# Cable Elements
panel = Panel("MATERIAL FOUR")
crv = Curve([<curve referenced from the Rhino model> x4])
crv_2 = Curve([<curve referenced from the Rhino model> x4])
path_mapper_4 = PathMapper([panel, crv], source="{0}", target="{0}")
path_mapper_5 = PathMapper(["MATERIAL FOUR", crv_2], source="{0}", target="{1}")
merge_4 = Merge(Data1=path_mapper_4, Data2=path_mapper_5)

# ----
# Elastics Elements
panel_2 = Panel("MATERIAL THREE")
crv_3 = Curve([<curve referenced from the Rhino model> x3])
crv_4 = Curve([<curve referenced from the Rhino model> x9])
path_mapper_6 = PathMapper([panel_2, crv_3], source="{0}", target="{0}")
path_mapper_7 = PathMapper(["MATERIAL THREE", crv_4], source="{0}", target="{1}")
merge_5 = Merge(Data1=path_mapper_6, Data2=path_mapper_7)

# ----
# ELEMENTS
# Bending Elements
panel_3 = Panel("MATERIAL ONE")
crv_5 = Curve(<curve referenced from the Rhino model>)
crv_6 = Curve([<curve referenced from the Rhino model> x2])
path_mapper_8 = PathMapper([panel_3, crv_6], source="{0}", target="{0}")
path_mapper_9 = PathMapper(["MATERIAL TWO", crv_5], source="{0}", target="{1}")
merge_6 = Merge(Data1=path_mapper_8, Data2=path_mapper_9)

merge_7 = Merge(Data1=path_mapper, Data2=path_mapper_2, Data3=path_mapper_3)
panel_4 = Panel(merge_4)
fixed_points = Point([<point referenced from the Rhino model> x6])
constrained_points = Point([<point referenced from the Rhino model> x4])
# make as low as possible 2200
run = BooleanToggle(True)
reset = BooleanToggle(True)
step_size = Slider(2200, range=1..50000)
timer = Timer(TimerInterval=2, Target=dynamic_relaxation_engine)

# ----
# LOADS
pt = Point([<point referenced from the Rhino model> x4])
newtons = Slider(2500, range=0..250000)
pt_2 = Point([<point referenced from the Rhino model> x4])
newtons_2 = Slider(2500, range=0..250000)
vec = VectorXYZ(XComponent=Slider(0, range=-1..1), YComponent=Slider(0, range=-1..1), ZComponent=Slider(1, range=-1..1))  # -> Vector, Length
vec_2 = VectorXYZ(XComponent=Slider(0, range=0..1), YComponent=Slider(1, range=0..1), ZComponent=Slider(0, range=0..1))  # -> Vector, Length
line = LineSDL(Start=pt, Direction=vec.Vector, Length=expr("L/100", newtons))
rev = Reverse(Vector=vec_2.Vector)
rev_2 = Reverse(Vector=vec.Vector)
vdis = VectorDisplay(Anchor=pt_2, Vector=rev)
vdis_2 = VectorDisplay(Anchor=pt, Vector=rev_2)

vec_3 = VectorXYZ(XComponent=newtons, YComponent=0, ZComponent=0)  # -> Vector, Length
vec_4 = VectorXYZ(XComponent=newtons_2, YComponent=0, ZComponent=0)  # -> Vector, Length
merge_8 = Merge(Data1=vec_2.Vector, Data2=vec_4.Vector, Data3=pt_2)
merge_9 = Merge(Data1=vec.Vector, Data2=vec_3.Vector, Data3=pt)

line_2 = LineSDL(Start=pt_2, Direction=vec_4.Vector, Length=expr("L/100", newtons_2))
path_mapper_10 = PathMapper(merge_9, source="{0}", target="{0}")
path_mapper_11 = PathMapper(merge_8, source="{0}", target="{1}")

merge_10 = Merge(Data1=path_mapper_10, Data2=path_mapper_11)
panel_5 = Panel(merge_10)
dynamic_relaxation_engine = PythonScript(
    bendings=merge_6,
    elastics=merge_5,
    loads=merge_10,
    fixedPoints=fixed_points,
    materials=merge_7,
    run=run,
    reset=reset,
    step=step_size)  # -> out, bendingsOUT, elasticsOUT, cablesOUT, stressOUT, stressMinMax, loadsOUT, fixedPointsOUT, particles; inputs bendings: tree, elastics: tree, cables: tree, loads: tree of Point3d, fixedPoints: list of Point3d, constrainedPoints: list of Point3d, materials: tree
# ---------- dynamic_relaxation_engine: Python ----------
import Rhino # this is all the Rhino common classes and stuff (documentation here: http://4.rhino3d.com/5/rhinocommon/)
import rhinoscriptsyntax as rs
import sys
#import DynamicRelaxationFaster as DynamicRelaxation
import DynamicRelaxation
import PreSpecMaterials
import itertools
import clr
clr.AddReference("Grasshopper")
from Grasshopper.Kernel.Data import GH_Path
from Grasshopper import DataTree

"""This component takes as input different sets of lines to define a dynamic relaxation (DR) process to find their equilibrium position.

This is the first example of a (hopefully) running code.

There are of course several things that need to be done:
    
    TODO allow for different materials in same kind of elements (e.g. tow different bending stiffnesses) maybe as pairs sets [ [list,material],[otherlist]other material]]
    TODO have a way to define generic materials (young modulus E + section area A + second moment of inertia I)(as a python class?)
    TODO add load elements as triple [position, direction, value]

The code is heavily inspired by the TraerPhysics library for Processing by J. Traer and several amendments/improvements 
made by Guillaume Labelle and Julien Nembrini in TraerAnar as a link to the ANAR+ library (http://anar.ch) 

This code is copyrighted by Julien Nembrini and distributed open source in the sense of the Gnu GPL v3.0. 

"""

#@@@@@@@@@@@@@@@@@@@@@@@@@@@@@@@
#@@@@@@@@@@@@@@@@@@@@@@@@@@@@@@@
#@@@@@@@@@@@@@@@@@@@@@@@@@@@@@@@
#@@@@@@@@@@@@@@@@@@@@@@@@@@@@@@@

def makePtFromRhino(pt):
    return DynamicRelaxation.Point3D(pt.X,pt.Y,pt.Z)
    
def makePtsFromRhino(pts):
    a = []
    for pt in pts:
        a.append(makePtFromRhino(pt))
    return a
    
#@@@@@@@@@@@@@@@@@@@@@@@@@@@@@@@
#@@@@@@@@@@@@@@@@@@@@@@@@@@@@@@@
#@@@@@@@@@@@@@@@@@@@@@@@@@@@@@@@
#@@@@@@@@@@@@@@@@@@@@@@@@@@@@@@@

print 'A prototype for dynamic relaxation in Rhino/GH/python. (c) Julien Nembrini'

#print sys.path

#@@@@@@@@@@@@@@@@@@@@@@@@@@@@@@@
#@@@@@@@@@@@@@@@@@@@@@@@@@@@@@@@
#@@@@@@@@@@@@@@@@@@@@@@@@@@@@@@@
#@@@@@@@@@@@@@@@@@@@@@@@@@@@@@@@

# Initialisation

if reset :
    
    # create particle system no drag no gravity
    ps = DynamicRelaxation.ParticleSystem()
    #ps = ParticleSystem(Vector3D(0,0,1), 0.5)
    #ps.setIntegrator(DynamicRelaxation.ParticleSystem.EULER)
    
    print ps
    
    #### materials
    matName = []
    matEval = []
    matAval = []
    matIval = []
    matCval = []

    for i in range(materials.BranchCount):
        matName.append (materials.Branch(i)[0])
        matEval.append (materials.Branch(i)[1])
        matAval.append (materials.Branch(i)[2])
        matIval.append (materials.Branch(i)[3])
        matCval.append (materials.Branch(i)[4])
        
    #### bending elements
    allBendings = [] 
    allBendingsParts = [] 
    for i in range(bendings.BranchCount):
        matSpec = bendings.Branch(i)[0]
        for j in itertools.islice(bendings.Branch(i),1,None):
            pts = rs.PolylineVertices(j)
            if pts: 
                #create the bending elements (registered automagically in ps)
                parts,bends = DynamicRelaxation.makeBendingsFromList(ps, makePtsFromRhino(pts),matEval[matName.index(matSpec)],matIval[matName.index(matSpec)],matAval[matName.index(matSpec)])
                # keep a copy for display of the particles making a bending line
                allBendingsParts.append(parts)
                allBendings.append(bends)
    
    print 'bendings :' + str(len(ps.bendings))
    
    #### elastic elements
    allElastics = [] 
    allElasticsParts = [] 
    
    for i in range(elastics.BranchCount):
        matSpec = elastics.Branch(i)[0]
        for j in itertools.islice(elastics.Branch(i),1,None):
            pts = rs.PolylineVertices(j)
            if pts: 
                #create the bending elements (registered automagically in ps)
                parts,elas = DynamicRelaxation.makeElasticsFromList(ps, makePtsFromRhino(pts), matEval[matName.index(matSpec)], matAval[matName.index(matSpec)], 10)##HOW TO GET TENSIONED ELASTICS?
                # keep a copy for display of the particles making a bending line
                allElasticsParts.append(parts)
                allElastics.append(elas)

    print 'elastics :' + str(len(ps.elastics))

    #### cables elements
    allCables = [] 
    allCablesParts = [] 

    for i in range(cables.BranchCount):
        matSpec = cables.Branch(i)[0]
        for j in itertools.islice(cables.Branch(i),1,None):
            pts = rs.PolylineVertices(j)
            if pts: 
                #create the bending elements (registered automagically in ps)
                parts,cabls = DynamicRelaxation.makeCablesFromList(ps, makePtsFromRhino(pts))
                # keep a copy for display of the particles making a bending line
                allCablesParts.append(parts)
                allCables.append(cabls)

    print 'cables :' + str(len(ps.cables))
    
    
    #### loads
    allLoads = [] 
    allLoadsParts = [] 

    for i in range(loads.BranchCount):
        dir = loads.Branch(i)[0]
        force = loads.Branch(i)[1]
        pts = []
        for j in itertools.islice(loads.Branch(i),2,None):
            if j is not None: pts.append (j)
            
        
        #create the load elements (registered automagically in ps)
        parts,lds = DynamicRelaxation.makeLoadsFromList(ps, makePtsFromRhino(pts),makePtFromRhino(dir),force.X) # TODO why is force a point3D, ia it to have only points
        # keep a copy for display of the particles making a load
        allLoadsParts.append(parts)
        allLoads.append(lds)
        
    print 'loads :' + str(len(ps.loads))
    
    # TODO make a construction loop for the remaining kind of elements
    #DynamicRelaxation.makeSpringsFromList(ps, makePtsFromRhino(pts),1,0)
    #DynamicRelaxation.makeAttractionsFromList(ps, makePtsFromRhino(pts),100)

    DynamicRelaxation.makeConstraintsFromList(ps,makePtsFromRhino(constrainedPoints))#GENERAL PROBLEM WITH NONE ITEMS HERE
    
    # fix particles at the end
    for pt in fixedPoints:
        ps.findParticleEqualToPoint(makePtFromRhino(pt)).makeFixed()
    
    
    print 'particles :' + str(len(ps.particles))

    stepCount = 0

#@@@@@@@@@@@@@@@@@@@@@@@@@@@@@@@
#@@@@@@@@@@@@@@@@@@@@@@@@@@@@@@@
#@@@@@@@@@@@@@@@@@@@@@@@@@@@@@@@
#@@@@@@@@@@@@@@@@@@@@@@@@@@@@@@@

# Dynamic Relaxation step

if run:
    for i in range(10):
        ps.step(step)
    ps.stepRelax(step)
    #stepCount += 1
    #print stepCount


#@@@@@@@@@@@@@@@@@@@@@@@@@@@@@@@
#@@@@@@@@@@@@@@@@@@@@@@@@@@@@@@@
#@@@@@@@@@@@@@@@@@@@@@@@@@@@@@@@
#@@@@@@@@@@@@@@@@@@@@@@@@@@@@@@@

# Display functions

#center = Rhino.Geometry.Point3d((supportPtsIn[0].X + supportPtsIn[1].X) * .5, (supportPtsIn[0].Y + supportPtsIn[1].Y) * .5, (supportPtsIn[0].Z + supportPtsIn[1].Z) * .5)

bendingsOUT = DataTree[Rhino.Geometry.PolylineCurve]()
elasticsOUT = DataTree[Rhino.Geometry.PolylineCurve]()
cablesOUT = DataTree[Rhino.Geometry.PolylineCurve]()
stressOUT = DataTree[float]()
stressSort = []
stressMinMax = []

# compare bending force between top and bottom of arch 
for i in range(len(allBendings)):
    path = GH_Path(i)
    for j in range(len(allBendings[i])):
        stressOUT.Add(allBendings[i][j].getStress(), path)
        stressSort.append(allBendings[i][j].getStress())
        if j == 0 or j == len(allBendings[i])-1:
            stressOUT.Add(allBendings[i][j].getStress(), path)
            stressSort.append(allBendings[i][j].getStress())
stressSort.sort()
stressMinMax.append(stressSort[0])
stressMinMax.append(stressSort[-1])

for i in range(len(allBendingsParts)):
    path = GH_Path(i)
    parts = []
    
    for p in allBendingsParts[i] :
        part = Rhino.Geometry.Point3d(p.position.x(), p.position.y(), p.position.z())
        parts.append(part)
        bendingsOUT.Add(Rhino.Geometry.PolylineCurve(parts), path)

for i in range(len(allElasticsParts)):
    path = GH_Path(i)
    parts = []
    for p in allElasticsParts[i] :
        part = Rhino.Geometry.Point3d(p.position.x(), p.position.y(), p.position.z())
        parts.append(part)
    elasticsOUT.Add(Rhino.Geometry.PolylineCurve(parts), path)

for i in range(len(allCablesParts)):
    path = GH_Path(i)
    parts = []
    for p in allCablesParts[i]:
        part = Rhino.Geometry.Point3d(p.position.x(), p.position.y(), p.position.z())
        parts.append(part)
        cablesOUT.Add(Rhino.Geometry.PolylineCurve(parts), path)

particles = []
for p in ps.particles:
    part = Rhino.Geometry.Point3d(p.position.x(), p.position.y(), p.position.z())
    particles.append(part)

#curveOut = Rhino.Geometry.PolylineCurve(pts)
# ---------- end dynamic_relaxation_engine ----------
pt_3 = Point(dynamic_relaxation_engine.particles)
crv_7 = Curve(dynamic_relaxation_engine.elasticsOUT)
item = ListItem(List=dynamic_relaxation_engine.stressMinMax, Index=1, Wrap=True)
item_2 = ListItem(List=dynamic_relaxation_engine.stressMinMax, Index=0, Wrap=True)
gradient = Gradient(
    LowerLimit=item_2,
    UpperLimit=item,
    Parameter=dynamic_relaxation_engine.stressOUT,
    stops=[0: RGB(0, 0, 255), 0.494: RGB(255, 255, 0), 1: RGB(255, 0, 0)])
panel_6 = Panel(dynamic_relaxation_engine.elasticsOUT)
preview = CustomPreview(Geometry=dynamic_relaxation_engine.bendingsOUT, Shader=gradient)
