# Grasshopper definition DynamicRelaxation.gh (Grasshopper 0.9.64)
# plug-ins: Python Interpreter

list = ValueList({"Circular Solid": 1, "Circular Tube": 2, "Rectangular Solid": 3}, selected="Circular Tube")
newtons = Slider(10, range=0..25000)
newtons_2 = Slider(9935.225, range=0..25000)
trigger = Slider(100, range=0..1000)
python = PythonScript(trigger=trigger, before=newtons, after=newtons_2)  # -> out, a
# ---------- python: Python ----------
if x > trigger:
    a = after
else:
    a = before
# ---------- end python ----------
area_moments_of_inertia_calculator = PythonScript(
    type=list,
    innerRadius=Slider(2, range=0..10),
    outerRadius=Slider(3, range=0..10),
    width=Slider(0.25, range=0..10),
    height=Slider(0.25, range=0..10))  # -> out, I
# ---------- area_moments_of_inertia_calculator: Python ----------
import math

def circular(r):
    return (math.pi/4)*math.pow(r,4)
    
def circularTube(r1, r2):
    print math.pow(r2,4) - math.pow(r1, 4)
    return (math.pi/4)*(math.pow(r2,4) - math.pow(r1, 4))

def rectangle(w,h):
    return (w*math.pow(h,3))/12

if type == 1:
    I = circular(outerRadius)
elif type == 2:
    I = circularTube(innerRadius, outerRadius)
elif type == 3:
    I = rectangle(width, height)
# ---------- end area_moments_of_inertia_calculator ----------
panel = Panel(area_moments_of_inertia_calculator.I)

# ----
# pre specified materials
youngs_modulus_of_elasticity_e = Slider(0.1, range=0..50000)
youngs_modulus_of_elasticity_e_2 = Slider(1, range=0..50000)
# Materials & sections can be chosen from the list of prespecified materials or user defined.
# 
# Add new material in the same manner as described above.
# 
# All materials have by default 5 parameters.  However, these are not all used by each material. For example, membrane materials do not take a value for second moment of inertia.  In these cases, the set value is ignored.
youngs_modulus_of_elasticity_e_3 = Slider(50000, range=0..50000)
coefficient = Slider(1, range=0..1)
second_moment_of_inertia_i = Slider(0.81, range=0..1000)
second_moment_of_inertia_i_2 = Slider(0.81, range=0..1000)
neutral_axis_distance = Slider(0.375, range=0..10)
neutral_axis_distance_2 = Slider(0.25, range=0..10)
second_moment_of_inertia_i_3 = Slider(0.785, range=0..1000)
coefficient_2 = Slider(1, range=0..1)
neutral_axis_distance_3 = Slider(1, range=0..10)
sectional_area_a = Slider(0.25, range=0..200)
sectional_area_a_2 = Slider(0.55, range=0..200)
sectional_area_a_3 = Slider(3.142, range=0..200)
user_material = PythonScript(
    NAME="MATERIAL TWO",
    E=youngs_modulus_of_elasticity_e,
    A=sectional_area_a,
    I=second_moment_of_inertia_i,
    D=neutral_axis_distance)  # -> out, MAT
# ---------- user_material: Python ----------
output = []

output.append(NAME)
if E is not None:
    output.append(E)
else:
    output.append(1)
if A is not None:
    output.append(A)
else:
    output.append(1)
if I is not None:
    output.append(I)
else:
    output.append(1)
if C is not None:
    output.append(C)
else:
    output.append(1)
if D is not None:
    output.append(D)
else:
    output.append(1)

MAT = output
# ---------- end user_material ----------
user_material_2 = PythonScript(
    NAME="MATERIAL THREE",
    E=youngs_modulus_of_elasticity_e_2,
    A=sectional_area_a_2,
    I=second_moment_of_inertia_i_2,
    C=coefficient,
    D=neutral_axis_distance_2)  # -> out, MAT; same code as user_material
user_material_3 = PythonScript(
    NAME="MATERIAL ONE",
    E=youngs_modulus_of_elasticity_e_3,
    A=sectional_area_a_3,
    I=second_moment_of_inertia_i_3,
    C=coefficient_2,
    D=neutral_axis_distance_3)  # -> out, MAT
# ---------- user_material_3: Python ----------
output = []

output.append(NAME)
if E is not None:
    output.append(E)
else:
    output.append(-1)
if A is not None:
    output.append(A)
else:
    output.append(-1)
if I is not None:
    output.append(I)
else:
    output.append(-1)
if C is not None:
    output.append(C)
else:
    output.append(-1)
if D is not None:
    output.append(D)
else:
    output.append(-1)

MAT = output
# ---------- end user_material_3 ----------
list_2 = ValueList({"GFRP_D2": 0, "GFRP_D3": 1, "STEEL_D2": 2, "RATTAN_D6": 3, "RATTAN_D10": 4, "WOOD_2*20": 5, "MEMBRANE": 6, "PVC_D2": 7}, selected=["GFRP_D2", "GFRP_D3", "STEEL_D2", "RATTAN_D6", "RATTAN_D10", "WOOD_2*20", "MEMBRANE", "PVC_D2"])
path_mapper = PathMapper(user_material.MAT, source="{0;0}", target="{1}")
path_mapper_2 = PathMapper(user_material_2.MAT, source="{0;0}", target="{2}")
path_mapper_3 = PathMapper(user_material_3.MAT, source="{0;0}", target="{0}")

# ----
# LOADS
# Loads can be single points or point collections.
# 
# New loads are added in the same manner as described above. Remember to increase the target integer in the path mapper component to the next unique integer.
# 
# Set the force in Newtons, and the direction of the force using X, Y and Z axis rotations.
pt = Point([<point referenced from the Rhino model> x5])
# LOADS
x_axis_rotation = Slider(180, range=0..360)
y_axis_rotation = Slider(0, range=0..360)
z_axis_rotation = Slider(0, range=0..360)
newtons_3 = Slider(20, range=0..25000)
pt_2 = Point([<point referenced from the Rhino model> x5])
# LOADS
x_axis_rotation_2 = Slider(0, range=0..360)
y_axis_rotation_2 = Slider(0, range=0..360)
# MATERIALS
# & sections
newtons_4 = Slider(20, range=0..25000)
z_axis_rotation_2 = Slider(0, range=0..360)
cluster = Cluster(A=x_axis_rotation, G=pt, A_3=z_axis_rotation, A_2=y_axis_rotation, X=newtons_3, d3=pt)  # -> V, G_2, V_2, R
cluster_2 = Cluster(A=x_axis_rotation_2, G=pt_2, A_3=z_axis_rotation_2, A_2=y_axis_rotation_2, X=newtons_4, d3=pt_2)  # -> V, G_2, V_2, R
line = LineSDL(Start=pt, Direction=cluster.V, Length=expr("abs(L)/500", newtons_3))
line_2 = LineSDL(Start=pt_2, Direction=cluster_2.V, Length=expr("abs(L)/500", newtons_4))
vdis = VectorDisplay(Anchor=cluster.G_2, Vector=cluster.V_2)
crv = Curve([<curve referenced from the Rhino model> x7])
crv_2 = Curve()
crv_3 = Curve([<curve referenced from the Rhino model> x9])

# ----
# Cable Elements
# (& membranes)
panel_2 = Panel("MATERIAL THREE")
path_mapper_4 = PathMapper([panel_2, crv], source="{0}", target="{0}")
path_mapper_5 = PathMapper(["MATERIAL THREE", crv_3], source="{0}", target="{1}")
merge = Merge(Data1=path_mapper_4, Data2=path_mapper_5)

crv_4 = Curve()

# ----
# Truss Elements
panel_3 = Panel("MATERIAL FOUR")
path_mapper_6 = PathMapper([panel_3, crv_2], source="{0}", target="{0}")
path_mapper_7 = PathMapper(["MATERIAL FOUR", crv_4], source="{0}", target="{1}")
merge_2 = Merge(Data1=path_mapper_6, Data2=path_mapper_7)

vdis_2 = VectorDisplay(Anchor=cluster_2.G_2, Vector=cluster_2.V_2)
crv_5 = Curve(<curve referenced from the Rhino model>)
crv_6 = Curve([<curve referenced from the Rhino model> x2])

# ----
# ELEMENTS
# Elements can be beam, truss or cable elements.
# 
# To make a new element collection, copy paste the naming panel, the curve collection and the path mapper (everything before the merge component). Increase the target value of the path mapper to the next unique integer.  Select new curves and name as appropriate.
# Beam Elements
panel_4 = Panel("MATERIAL ONE")
path_mapper_8 = PathMapper([panel_4, crv_6], source="{0}", target="{0}")
path_mapper_9 = PathMapper(["STEEL_D2", crv_5], source="{0}", target="{1}")
merge_3 = Merge(Data1=path_mapper_8, Data2=path_mapper_9)

path_mapper_10 = PathMapper(cluster.R, source="{0}", target="{0}")
path_mapper_11 = PathMapper(cluster_2.R, source="{0}", target="{1}")
merge_4 = Merge(Data1=path_mapper_3, Data2=path_mapper, Data3=path_mapper_2)
python_2 = PythonScript(preSpecified=list_2, userDefined=merge_4)  # -> out, a; inputs preSpecified: list, userDefined: tree
# ---------- python_2: Python ----------
from PreSpecMaterials import Materials
import clr
clr.AddReference("Grasshopper")
from Grasshopper.Kernel.Data import GH_Path
from Grasshopper import DataTree

PreSpecMatList = userDefined
exLength = PreSpecMatList.BranchCount

mat = Materials()

# I is the second moment of area 
#   http://en.wikipedia.org/wiki/Second_moment_of_area
#   http://en.wikipedia.org/wiki/List_of_area_moments_of_inertia
# A is the section area
# D is the distance to the neutral axis in the the direction in which I is computed

for preset in preSpecified:
    exLength += 1
    if preset == 0:#GFRP_D2
        for i in mat.gfrp(NAME = 'GFRP_D2', A = 3.1415, I = 0.78539, D = 1):
            PreSpecMatList.Add(i, GH_Path(exLength))
    elif preset == 1:#GFRP_D3
        for i in mat.gfrp(NAME = 'GFRP_D3', A = 7.068375, I = 3.976078, D = 1.5):
            PreSpecMatList.Add(i, GH_Path(exLength))
    elif preset ==2:#STEEL_D2
        for i in mat.steel(NAME = 'STEEL_D2', A = 3.1415, I = 0.78539, D = 1):
            PreSpecMatList.Add(i, GH_Path(exLength))
    elif preset ==3:#RATTAN_D6
        for i in mat.rattan(NAME = 'RATTAN_D6', A = 28.2735, I = 63.617251, D = 3):
            PreSpecMatList.Add(i, GH_Path(exLength))
    elif preset ==4:#RATTAN_D10
        for i in mat.rattan(NAME = 'RATTAN_D10', A = 78.5375, I = 490.873852, D = 5):
            PreSpecMatList.Add(i, GH_Path(exLength))
    elif preset ==5:#WOOD_2*20
        for i in mat.wood(NAME = 'WOOD_2x20', A = 40, I = 13.333333, D = 1):
            PreSpecMatList.Add(i, GH_Path(exLength))
    elif preset ==6:#MEMBRANE
        for i in mat.membrane(NAME = 'MEMBRANE', A = 0.01, C = 0.9):
            PreSpecMatList.Add(i, GH_Path(exLength))
    elif preset ==7:#PVC
        for i in mat.pvc(NAME = 'PVC_D2', A = 3.1415, I = 0.78539, D = 1):
            PreSpecMatList.Add(i, GH_Path(exLength))
        
        
        
a = PreSpecMatList
# ---------- end python_2 ----------
merge_5 = Merge(Data1=path_mapper_10, Data2=path_mapper_11)
panel_5 = Panel(python_2.a)
crv_7 = Curve(<curve referenced from the Rhino model>)
pt_3 = Point([<point referenced from the Rhino model> x5])
pin_joints = Point([<point referenced from the Rhino model> x4])
constrained_pin_joints = Point()
run = BooleanToggle(True)
reset = BooleanToggle(False)
adjust_forces = BooleanToggle(False)
step_size = Slider(1906.223, range=1..50000)
timer = Timer(TimerInterval=2, Target=dynamic_relaxation_engine)
dynamic_relaxation_engine = PythonScript(
    bendings=merge_3,
    elastics=merge_2,
    cables=merge,
    loads=merge_5,
    fixedPoints=pin_joints,
    constrainedPoints=constrained_pin_joints,
    railConstraints=crv_7,
    railConstrainedPt=pt_3,
    materials=python_2.a,
    run=run,
    reset=reset,
    step=step_size,
    adjust=adjust_forces)  # -> out, bendingsOUT, elasticsOUT, cablesOUT, stressOUT, stressMinMax, loadsOUT, loadsDirOUT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; inputs bendings: tree, elastics: tree, cables: tree, loads: tree of Point3d, fixedPoints: list of Point3d, constrainedPoints: list of Point3d, railConstraints: Curve, railConstrainedPt: list of Point3d, materials: tree
# ---------- dynamic_relaxation_engine: Python ----------
import Rhino # this is all the Rhino common classes and stuff (documentation here: http://4.rhino3d.com/5/rhinocommon/)
import rhinoscriptsyntax as rs
import sys
#import DynamicRelaxationFaster as DynamicRelaxation
import DynamicRelaxation
from PreSpecMaterials import Materials
import itertools
import clr
clr.AddReference("Grasshopper")
from Grasshopper.Kernel.Data import GH_Path
from Grasshopper import DataTree
import System.Guid
"""This component takes as input different sets of lines to define a dynamic relaxation (DR) process to find their equilibrium position.

This is the first example of a (hopefully) running code.

There are of course several things that need to be done:
    
    TODO allow for different materials in same kind of elements (e.g. tow different bending stiffnesses) maybe as pairs sets [ [list,material],[otherlist]other material]]
    TODO have a way to define generic materials (young modulus E + section area A + second moment of inertia I)(as a python class?)
    TODO add load elements as triple [position, direction, value]

The code is heavily inspired by the TraerPhysics library for Processing by J. Traer and several amendments/improvements 
made by Guillaume Labelle and Julien Nembrini in TraerAnar as a link to the ANAR+ library (http://anar.ch) 

This code is copyrighted by Julien Nembrini and distributed open source in the sense of the Gnu GPL v3.0. 

"""

#@@@@@@@@@@@@@@@@@@@@@@@@@@@@@@@
#@@@@@@@@@@@@@@@@@@@@@@@@@@@@@@@
#@@@@@@@@@@@@@@@@@@@@@@@@@@@@@@@
#@@@@@@@@@@@@@@@@@@@@@@@@@@@@@@@

def makePtFromRhino(pt):
    return DynamicRelaxation.Point3D(pt.X,pt.Y,pt.Z)
    
def makePtsFromRhino(pts):
    a = []
    for pt in pts:
        a.append(makePtFromRhino(pt))
    return a
    
def makeVecfromPoint3D(p):
    return Rhino.Geometry.Point3d(p.x(),p.y(),p.z())


#@@@@@@@@@@@@@@@@@@@@@@@@@@@@@@@
#@@@@@@@@@@@@@@@@@@@@@@@@@@@@@@@
#@@@@@@@@@@@@@@@@@@@@@@@@@@@@@@@
#@@@@@@@@@@@@@@@@@@@@@@@@@@@@@@@

class CurveConstraint(object):
    def __init__(self,crv):
        self.curve = crv
        
    def apply(self,v):
        b,val = Rhino.Geometry.Curve.ClosestPoint(self.curve,makeVecfromPoint3D(v.position))
        if b:
            return makePtFromRhino(self.curve.PointAtLength(val))
        else :
            v.position


#@@@@@@@@@@@@@@@@@@@@@@@@@@@@@@@
#@@@@@@@@@@@@@@@@@@@@@@@@@@@@@@@
#@@@@@@@@@@@@@@@@@@@@@@@@@@@@@@@
#@@@@@@@@@@@@@@@@@@@@@@@@@@@@@@@


print 'A prototype for dynamic relaxation in Rhino/GH/python. (c) Julien Nembrini'

#print sys.path

#@@@@@@@@@@@@@@@@@@@@@@@@@@@@@@@
#@@@@@@@@@@@@@@@@@@@@@@@@@@@@@@@
#@@@@@@@@@@@@@@@@@@@@@@@@@@@@@@@
#@@@@@@@@@@@@@@@@@@@@@@@@@@@@@@@

# Initialisation

if reset :

    # create particle system no drag no gravity
    ps = DynamicRelaxation.ParticleSystem()
    #ps = ParticleSystem(Vector3D(0,0,1), 0.5)
    #ps.setIntegrator(DynamicRelaxation.ParticleSystem.EULER)
    
    print ps

    #### materials
    matName = []
    matEval = []
    matAval = []
    matIval = []
    matCval = []
    matDval = []
    
    for i in range(materials.BranchCount):
        matName.append (materials.Branch(i)[0])
        matEval.append (materials.Branch(i)[1])
        matAval.append (materials.Branch(i)[2])
        matIval.append (materials.Branch(i)[3])
        matCval.append (materials.Branch(i)[4])
        matDval.append (materials.Branch(i)[5])
     
    print matDval
    #### bending elements
    allBendings = [] 
    allBendingsParts = [] 
    for i in range(bendings.BranchCount):
        matSpec = bendings.Branch(i)[0]
        for j in itertools.islice(bendings.Branch(i),1,None):
            if type(j) is System.Guid:
                pts = rs.PolylineVertices(j)
                if pts: 
                    #create the bending elements (registered automagically in ps)
                    parts,bends = DynamicRelaxation.makeBendingsFromList(ps, makePtsFromRhino(pts),matEval[matName.index(matSpec)],matIval[matName.index(matSpec)],matAval[matName.index(matSpec)], matDval[matName.index(matSpec)])
                    for bend in bends:
                        bend.setMaterialName(matSpec)
                    # keep a copy for display of the particles making a bending line
                    allBendingsParts.append(parts)
                    allBendings.append(bends)
    
    print 'bendings :' + str(len(ps.bendings))
    
    #### elastic elements
    allElastics = [] 
    allElasticsParts = [] 
    
    for i in range(elastics.BranchCount):
        matSpec = elastics.Branch(i)[0]
        for j in itertools.islice(elastics.Branch(i),1,None):
            if type(j) is System.Guid:
                pts = rs.PolylineVertices(j)
                if pts: 
                    #create the bending elements (registered automagically in ps)
                    parts,elas = DynamicRelaxation.makeElasticsFromList(ps, makePtsFromRhino(pts), matEval[matName.index(matSpec)], matAval[matName.index(matSpec)], 0,  matCval[matName.index(matSpec)])##HOW TO GET TENSIONED ELASTICS?
                    # keep a copy for display of the particles making a bending line
                    allElasticsParts.append(parts)
                    allElastics.append(elas)

    print 'elastics :' + str(len(ps.elastics))

    #### cables elements
    allCables = [] 
    allCablesParts = [] 

    for i in range(cables.BranchCount):
        matSpec = cables.Branch(i)[0]
        for j in itertools.islice(cables.Branch(i),1,None):
            if type(j) is System.Guid:
                pts = rs.PolylineVertices(j)
                if pts: 
                    #create the bending elements (registered automagically in ps)
                    parts,cabls = DynamicRelaxation.makeCablesFromList(ps, makePtsFromRhino(pts))
                    # keep a copy for display of the particles making a bending line
                    allCablesParts.append(parts)
                    allCables.append(cabls)

    print 'cables :' + str(len(ps.cables))
    
    #### loads
    allLoads = [] 
    allLoadsParts = [] 

    for i in range(loads.BranchCount):
        dir = loads.Branch(i)[0]
        force = loads.Branch(i)[1]
        pts = []
        for j in itertools.islice(loads.Branch(i),2,None):
            if j is not None: 
                pts.append (j)
        #create the load elements (registered automagically in ps)
        parts,lds = DynamicRelaxation.makeLoadsFromList(ps, makePtsFromRhino(pts),makePtFromRhino(dir),force.X) # TODO why is force a point3D, ia it to have only points
        # keep a copy for display of the particles making a load
        allLoadsParts.append(parts)
        allLoads.append(lds)
        
    print 'loads :' + str(len(ps.loads))
    
    # TODO make a construction loop for the remaining kind of elements
    #DynamicRelaxation.makeSpringsFromList(ps, makePtsFromRhino(pts),1,0)
    #DynamicRelaxation.makeAttractionsFromList(ps, makePtsFromRhino(pts),100)
    cPoints = []
    for j in constrainedPoints:
        if j is not None: cPoints.append (j)
    DynamicRelaxation.makeConstraintsFromList(ps,makePtsFromRhino(cPoints))#GENERAL PROBLEM WITH NONE ITEMS HERE
    
    
    rail = CurveConstraint(railConstraints)
    DynamicRelaxation.makeOutsideSpringConstraintsFromList(ps,makePtsFromRhino(railConstrainedPt), rail.apply, 100, 0)
    
    
    # fix particles at the end
    for pt in fixedPoints:
        ps.findParticleEqualToPoint(makePtFromRhino(pt)).makeFixed()
    
    print 'particles :' + str(len(ps.particles))

    stepCount = 0

#@@@@@@@@@@@@@@@@@@@@@@@@@@@@@@@
#@@@@@@@@@@@@@@@@@@@@@@@@@@@@@@@
#@@@@@@@@@@@@@@@@@@@@@@@@@@@@@@@
#@@@@@@@@@@@@@@@@@@@@@@@@@@@@@@@

#adjustment of material parameters during simulation

if adjust:
    #### import all material parameters again
    matName = []
    matEval = []
    matAval = []
    matIval = []
    matCval = []
    matDval = []
    
    for i in range(materials.BranchCount):
        matName.append (materials.Branch(i)[0])
        matEval.append (materials.Branch(i)[1])
        matAval.append (materials.Branch(i)[2])
        matIval.append (materials.Branch(i)[3])
        matCval.append (materials.Branch(i)[4])
        matDval.append (materials.Branch(i)[5])

    #### apply material adjustments to elements
    for bending in allBendings:
        for bend in bending:
            matSpec = bend.getMaterialName()
            bend.setEI( matEval[matName.index(matSpec)], matIval[matName.index(matSpec)] )
            bend.setES( matEval[matName.index(matSpec)], matAval[matName.index(matSpec)]  )
        #So this works, but.......
        #the problem here is that a bend (or any element) has no memory of its material. Its ordering within a 2D array has also been lost (which is a shame - perhaps a site for future work)
        #It may be that the easiest way to do this is to add a self.materialName to the Bending class.  This would store the material name, ie. GFRP or MATERIAL ONE. If the name doesnt change, just the values, then we can find the name in the list and use its index to assign the new values.


#@@@@@@@@@@@@@@@@@@@@@@@@@@@@@@@
#@@@@@@@@@@@@@@@@@@@@@@@@@@@@@@@
#@@@@@@@@@@@@@@@@@@@@@@@@@@@@@@@
#@@@@@@@@@@@@@@@@@@@@@@@@@@@@@@@

# Dynamic Relaxation step

if run:
    for i in range(10):
        ps.step(step)
    ps.stepRelax(step)
    stepCount += 1
    #print stepCount


#@@@@@@@@@@@@@@@@@@@@@@@@@@@@@@@
#@@@@@@@@@@@@@@@@@@@@@@@@@@@@@@@
#@@@@@@@@@@@@@@@@@@@@@@@@@@@@@@@
#@@@@@@@@@@@@@@@@@@@@@@@@@@@@@@@

# Display functions

#center = Rhino.Geometry.Point3d((supportPtsIn[0].X + supportPtsIn[1].X) * .5, (supportPtsIn[0].Y + supportPtsIn[1].Y) * .5, (supportPtsIn[0].Z + supportPtsIn[1].Z) * .5)

bendingsOUT = DataTree[Rhino.Geometry.PolylineCurve]()
elasticsOUT = DataTree[Rhino.Geometry.PolylineCurve]()
cablesOUT = DataTree[Rhino.Geometry.PolylineCurve]()
stressOUT = DataTree[float]()
stressSort = []
stressMinMax = []
loadsOUT = DataTree[Rhino.Geometry.Point3d]()
loadsDirOUT = DataTree[Rhino.Geometry.Vector3d]()
# compare bending force between top and bottom of arch 
for i in range(len(allBendings)):
    path = GH_Path(i)
    for j in range(0, len(allBendings[i])+1):
        if j == 0:
            tmpStress = allBendings[i][j].getStress()
        elif j == len(allBendings[i]):
            tmpStress = allBendings[i][j-1].getStress()
        else:
            tmpStress = (allBendings[i][j].getStress()+allBendings[i][j-1].getStress())*0.5
        stressOUT.Add(tmpStress, path)
        stressSort.append(tmpStress)

stressSort.sort()
stressMinMax.append(stressSort[0])
stressMinMax.append(stressSort[-1])

for i in range(len(allBendingsParts)):
    path = GH_Path(i)
    parts = []
    for p in allBendingsParts[i] :
        part = Rhino.Geometry.Point3d(p.position.x(), p.position.y(), p.position.z())
        parts.append(part)
    bendingsOUT.Add(Rhino.Geometry.PolylineCurve(parts), path)

for i in range(len(allElasticsParts)):
    path = GH_Path(i)
    parts = []
    for p in allElasticsParts[i] :
        part = Rhino.Geometry.Point3d(p.position.x(), p.position.y(), p.position.z())
        parts.append(part)
    elasticsOUT.Add(Rhino.Geometry.PolylineCurve(parts), path)

for i in range(len(allCablesParts)):
    path = GH_Path(i)
    parts = []
    for p in allCablesParts[i]:
        part = Rhino.Geometry.Point3d(p.position.x(), p.position.y(), p.position.z())
        parts.append(part)
    cablesOUT.Add(Rhino.Geometry.PolylineCurve(parts), path)

particles = []
for p in ps.particles:
    part = Rhino.Geometry.Point3d(p.position.x(), p.position.y(), p.position.z())
    particles.append(part)

for i in range(len(allLoads)):
    path = GH_Path(i)
    parts = []
    for l in allLoads[i]: 
        p = l.getParticle()
        loadsOUT.Add(Rhino.Geometry.Point3d(p.position.x(), p.position.y(), p.position.z()), path)
        loadsDirOUT.Add(Rhino.Geometry.Vector3d(makeVecfromPoint3D(l.getDirection())), path)
#curveOut = Rhino.Geometry.PolylineCurve(pts)

stepCounter = stepCount
# ---------- end dynamic_relaxation_engine ----------
pt_4 = Point(dynamic_relaxation_engine.loadsOUT)
pt_5 = Point(dynamic_relaxation_engine.particles)
crv_8 = Curve(dynamic_relaxation_engine.elasticsOUT)
crv_9 = Curve(dynamic_relaxation_engine.cablesOUT)
panel_6 = Panel(dynamic_relaxation_engine.stepCounter)
vdis_3 = VectorDisplay(Anchor=pt_4, Vector=dynamic_relaxation_engine.loadsDirOUT)
item = ListItem(List=dynamic_relaxation_engine.stressMinMax, Index=1, Wrap=True)
item_2 = ListItem(List=dynamic_relaxation_engine.stressMinMax, Index=0, Wrap=True)
gradient = Gradient(
    LowerLimit=item_2,
    UpperLimit=item,
    Parameter=dynamic_relaxation_engine.stressOUT,
    stops=[0: RGB(0, 0, 255), 0.494: RGB(255, 255, 0), 1: RGB(255, 0, 0)])
explode = Explode(Curve=dynamic_relaxation_engine.bendingsOUT, Recursive=True)  # -> Segments, Vertices
preview = CustomPreview(Geometry=explode.Segments, Shader=gradient)

# ==== cluster Cluster
line = LineSDL(Start=Point(0, 0, 0), Direction=Vector(1, 0, 0), Length=1)
line_2 = LineSDL(Start=Point(0, 0, 0), Direction=Vector(0, 1, 0), Length=1)
line_3 = LineSDL(Start=Point(0, 0, 0), Direction=Vector(0, 0, 1), Length=1)
line_4 = LineSDL(Start=Point(0, 0, 0), Direction=Vector(0, 0, 1), Length=1)
A = ClusterInput()
X = ClusterInput()
vrot = Rotate(Vector=line_4, Axis=line, Angle=degrees(A))
vec = VectorXYZ(XComponent=X, YComponent=0, ZComponent=0)  # -> Vector, Length
A_2 = ClusterInput()
A_3 = ClusterInput()
vrot_2 = Rotate(Vector=vrot, Axis=line_2, Angle=degrees(A_2))
vrot_3 = Rotate(Vector=vrot_2, Axis=line_3, Angle=degrees(A_3))
G = ClusterInput()
rev = Reverse(Vector=vrot_3)
V = ClusterOutput(vrot_3)
d3 = ClusterInput()
move = Move(Geometry=G, Motion=vrot_3)  # -> Geometry, Transform
V_2 = ClusterOutput(rev)
merge = Merge(Data1=rev, Data2=vec.Vector, Data3=d3)
G_2 = ClusterOutput(move.Geometry)
R = ClusterOutput(merge)
